# Grasshopper definition GrasshopperExample.gh (Grasshopper 0.9.76)
# plug-ins: gHowl, LunchBox

number_slider = Slider(7.5, range=0..10)  # disabled
number_slider_2 = Slider(29, range=0..100)  # disabled

number_slider_3 = Slider(-32, range=-100..100)  # disabled
number_slider_4 = Slider(-53, range=-100..100)  # disabled
number_slider_5 = Slider(10, range=-100..100)  # disabled
number_slider_6 = Slider(2, range=0..10)  # disabled
number_slider_7 = Slider(2, range=0..10)  # disabled
number_slider_8 = Slider(-1, range=-1..1)  # disabled
subtraction = Subtraction(A=number_slider_6, B=1)  # disabled
pt = ConstructPoint(XCoordinate=number_slider_4, YCoordinate=number_slider_3, ZCoordinate=number_slider_5)  # disabled
series = Series(Start=0, Step=number_slider_2, Count=number_slider_6)  # disabled
multiplication = Multiplication(A=number_slider_2, B=subtraction)  # disabled
multiplication_2 = Multiplication(A=multiplication, B=number_slider_8)  # disabled
division = Division(A=multiplication_2, B=number_slider_7)  # disabled
X = UnitX(Factor=series)  # disabled
Z = UnitZ(Factor=division)  # disabled
Y = UnitY(Factor=division)  # disabled
X_2 = UnitX(Factor=division)  # disabled
Y_2 = UnitY(Factor=series)  # disabled
move = Move(Geometry=pt, Motion=X)  # -> Geometry, Transform; disabled
graft = GraftTree(Tree=move.Geometry, IncludeEmptyLists=True, IncludeNullItems=True)  # disabled
move_2 = Move(Geometry=graft, Motion=Y_2)  # -> Geometry, Transform; disabled
Z_2 = UnitZ(Factor=series)  # disabled
graft_2 = GraftTree(Tree=move_2.Geometry, IncludeEmptyLists=True, IncludeNullItems=True)  # disabled
move_3 = Move(Geometry=graft_2, Motion=Z_2)  # -> Geometry, Transform; disabled
platocube = PlatonicCube(Plane=move_3.Geometry, Radius=number_slider, Truncation=0)  # disabled
debrep = DeconstructBrep(Brep=platocube)  # -> Faces, Edges, Vertices; disabled
move_4 = Move(Geometry=debrep.Faces, Motion=X_2)  # -> Geometry, Transform; disabled
move_5 = Move(Geometry=move_4.Geometry, Motion=Y)  # -> Geometry, Transform; disabled
move_6 = Move(Geometry=move_5.Geometry, Motion=Z)  # -> Geometry, Transform; disabled

number_slider_9 = Slider(20, range=0..100)  # disabled
number_slider_10 = Slider(20, range=0..100)  # disabled
rectangle = Rectangle(Plane=PlaneXY(0, 0, 0), XSize=number_slider_10, YSize=number_slider_9, Radius=0)  # -> Rectangle, Length; disabled
number_slider_11 = Slider(-29, range=-100..100)  # disabled
number_slider_12 = Slider(34, range=-100..100)  # disabled
X_3 = UnitX(Factor=number_slider_11)  # disabled
number_slider_13 = Slider(9, range=0..10)  # disabled
move_7 = Move(Geometry=rectangle.Rectangle, Motion=X_3)  # -> Geometry, Transform; disabled
Y_3 = UnitY(Factor=number_slider_12)  # disabled
move_8 = Move(Geometry=move_7.Geometry, Motion=Y_3)  # -> Geometry, Transform; disabled
Z_3 = UnitZ(Factor=number_slider_13)  # disabled
extr = Extrude(Base=move_8.Geometry, Direction=Z_3)  # disabled
cap = CapHoles(Brep=extr)  # disabled
debrep_2 = DeconstructBrep(Brep=cap)  # -> Faces, Edges, Vertices; disabled

number_slider_14 = Slider(89, range=-100..100)  # disabled
number_slider_15 = Slider(9, range=-100..100)  # disabled
number_slider_16 = Slider(9, range=0..100)
number_slider_17 = Slider(8, range=0..100)  # disabled
number_slider_18 = Slider(5, range=-100..100)  # disabled
number_slider_19 = Slider(-32, range=-100..100)  # disabled
X_4 = UnitX(Factor=Slider(20, range=0..100))
series_2 = Series(Start=0, Step=Slider(4, range=0..100), Count=number_slider_16)
pi = Pi(Factor=1)
polygon = Polygon(Plane=PlaneXY(0, 0, 0), Radius=Slider(17, range=0..100), Segments=Slider(4, range=0..10), FilletRadius=0)  # -> Polygon, Length
move_9 = Move(Geometry=polygon.Polygon, Motion=Vector(0, 0, 10))  # -> Geometry, Transform
Z_4 = UnitZ(Factor=series_2)
Y_4 = UnitY(Factor=Slider(20, range=0..100))
# Get the faces of a rectangular box
pt_2 = ConstructPoint(XCoordinate=number_slider_15, YCoordinate=number_slider_14, ZCoordinate=number_slider_17)  # disabled
division_2 = Division(A=pi, B=Slider(30, range=0..100))
move_10 = Move(Geometry=polygon.Polygon, Motion=Z_4)  # -> Geometry, Transform
box = CenterBox(Base=pt_2, X=number_slider_19, Y=number_slider_18, Z=number_slider_17)  # disabled
series_3 = Series(Start=0, Step=division_2, Count=number_slider_16)
debrep_3 = DeconstructBrep(Brep=box)  # -> Faces, Edges, Vertices; disabled
graph = GraphMapper(
    series_3,
    x0=0,
    x1=3.1415,
    y0=0,
    y1=1,
    container_name="Parabola",
    Ox=0.4130434692,
    Oy=0.3695651889,
    Px=0.8449273705,
    Py=0.6434781551)
rotate = Rotate(Geometry=move_10.Geometry, Angle=graph, Plane=PlaneXY(0, 0, 0))  # -> Geometry, Transform
# Translate the surfaces into meshes
# (be sure to use 'Triangular Panels A')
loft = Loft(Curves=rotate.Geometry, Options={Adjust=False, Closed=False, LoftEnds=0, LoftSimp=0, LoftType=0, Rebuild=10, Refit=0.01})
debrep_4 = DeconstructBrep(Brep=loft)  # -> Faces, Edges, Vertices
cap_2 = CapHoles(Brep=loft)
cir = Circle(Plane=PlaneXY(0, 0, 0), Radius=Slider(68, range=0..100))
number_slider_20 = Slider(5, range=0..10)
Z_5 = UnitZ(Factor=Slider(59, range=0..100))
extr_2 = Extrude(Base=cir, Direction=Z_5)
flip = Flip(Surface=debrep_4.Faces, Guide=extr_2)  # -> Surface, Result
debrep_5 = DeconstructBrep(Brep=cap_2)  # -> Faces, Edges, Vertices
tric = TrianglePanelsC(Surface=flip.Surface, UDivisions=number_slider_20, VDivisions=number_slider_20)  # -> graft(Panels)
debrep_6 = DeconstructBrep(Brep=tric)  # -> Faces, Edges, flatten(Vertices)
item = ListItem(List=debrep_5.Faces, Index=0, Wrap=True)
number_slider_21 = Slider(1, range=0..100)  # disabled
number_slider_22 = Slider(2, range=0..10)
number_slider_23 = Slider(1, range=0..1)
debrep_7 = DeconstructBrep(Brep=item)  # -> Faces, Edges, Vertices
partition = PartitionList(List=debrep_6.Vertices, Size=Slider(3, range=0..10))
tria = TriangularPanelsA(Surface=move_6.Geometry, UDivisions=number_slider_21, VDivisions=number_slider_21)  # disabled
item_2 = ListItem(List=debrep_7.Vertices, Index=0, Wrap=True)
item_3 = ListItem(List=debrep_7.Vertices, Index=number_slider_23, Wrap=True)
item_4 = ListItem(List=debrep_7.Vertices, Index=number_slider_22, Wrap=True)
item_5 = ListItem(List=partition, Index=number_slider_22, Wrap=True)
item_6 = ListItem(List=partition, Index=number_slider_23, Wrap=True)
weave = Weave(Pattern=[0, 1], Stream0=item_5, Stream1=item_6, NullGaps=False)
item_7 = ListItem(List=partition, Index=0, Wrap=True)
weave_2 = Weave(Pattern=[0, 1], Stream0=item_4, Stream1=item_3, NullGaps=False)
weave_3 = Weave(Pattern=[0, 1], Stream0=item_2, Stream1=weave_2, NullGaps=False)  # -> flatten(Weave)
weave_4 = Weave(Pattern=[0, 1], Stream0=item_7, Stream1=weave, NullGaps=False)  # -> flatten(Weave)
merge = Merge(Data1=weave_3, Data2=weave_4)  # -> flatten(Result)
panel = Panel(weave_3)
pdecon = Deconstruct(Point=merge)  # -> XComponent, YComponent, ZComponent
int = Integer(pdecon.XComponent)
concat = Concatenate(FragmentA=int, FragmentB=",")
int_2 = Integer(pdecon.YComponent)
concat_2 = Concatenate(FragmentA=concat, FragmentB=int_2)
concat_3 = Concatenate(FragmentA=concat_2, FragmentB=",")
int_3 = Integer(pdecon.ZComponent)
concat_4 = Concatenate(FragmentA=concat_3, FragmentB=int_3)
concat_5 = Concatenate(FragmentA=concat_4, FragmentB=",")
join = TextJoin(Text=concat_5)
len = TextLength(Text=join)
subtraction_2 = Subtraction(A=len, B=Slider(1, range=0..10))
fragment = TextFragment(Text=join, Start=Slider(0, range=0..1), Count=subtraction_2)
port_to_send_to = Panel("8051")
sending_pattern = Panel("0")
panel_2 = Panel("gHowl UDP sender")
parsed_mesh_data = Panel(fragment)
udp_owl = UDPSender(Port=port_to_send_to, Pattern=sending_pattern, Data=fragment)
